# Grasshopper definition grasshopper mesh.gh (Grasshopper 1.0.7)
# plug-ins: Kangaroo2 Components, PTComponentLibrary

srf = Surface(<surface referenced from the Rhino model>)
mesh = Mesh()
sdivide = DivideSurface(Surface=srf, UCount=Slider(10, range=1..10), VCount=Slider(3, range=1..10))  # -> Points, Normals, Parameters
ptsrfdomnum = SurfaceDomainNumber(UNumber=10, VNumber=10)
triremesh = TriRemesh(Geometry=srf, Length=Slider(4, range=1..20), Iterations=25)  # -> Triangulation, Dual, Creases
crvsrf = CurveOnSurface(Surface=srf, UVCoordinates=sdivide.Parameters, Closed=False)  # -> Curve, Length, Domain
medges = MeshEdges(Mesh=triremesh.Triangulation)  # -> NakedEdges, InteriorEdges, NonManifoldEdges
demesh = DeconstructMesh(Mesh=triremesh.Triangulation)  # -> Vertices, Faces, Colours, Normals
ptoffsetgrid = OffsetGrid(Grid=demesh.Vertices, BRep=srf, Dis=Slider(1, range=1..10))  # disabled
pt = Point(demesh.Vertices)
brep = Brep([<brep referenced from the Rhino model> x6])
ptmorph3d = Morph3D(Grid1=demesh.Vertices, Grid2=ptoffsetgrid, Shift_i=1, Shift_j=1, Pull=False)  # disabled
